# Grasshopper definition getEcByName.gh (Grasshopper 1.0.7)

panel = Panel("Concrete")
panel_2 = Panel("Glass")
panel_3 = Panel("Timber")

# ----
# Embodied Carbon API (PoC)
toggle = BooleanToggle(True)
getecbyname = GhPythonScript(live=toggle, query="Aluminium")  # -> id, iceDbName, comment, unit, embodiedCarbonPerUnit
# ---------- getecbyname: Python ----------
import urllib2
import json

if live:
    id = []
    iceDbName = []
    comment = []
    unit = []
    embodiedCarbonPerUnit = []
    
    url = "https://dla-hubs-ec-api.deno.dev/ice3.0a/ec_by_name/{query}".format(query=query)
    
    request = urllib2.Request(url)
    response = urllib2.urlopen(request) 
    response_dic = json.load(response)["main"]
    
    for item in response_dic:
        id.append(item["id"])
        iceDbName.append(item["iceDbName"])
        comment.append(item["comment"])
        unit.append(item["unit"])
        embodiedCarbonPerUnit.append(item["embodiedCarbonPerUnit"])
# ---------- end getecbyname ----------

# ----
# Embodied Carbon
# per Unit
# DESCRIPTION
# UNIT
# ID
# NAME
panel_4 = Panel(getecbyname.id)
panel_5 = Panel(getecbyname.iceDbName)
panel_6 = Panel(getecbyname.comment)
panel_7 = Panel(getecbyname.unit)
panel_8 = Panel(getecbyname.embodiedCarbonPerUnit)
